# Dynamo graph Walls By Level.dyn (Dynamo 4.0.0.3277)

# group: Collect All Walls
# Collect all wall instances in model
categories = Categories("OST_Walls")
all_elements_of_category = ElementsOfCategory(Category=categories)

# group: Filter Out Interior Walls
elementType = Element.ElementType(element=all_elements_of_category)
function = WallType.Function(wallType=elementType)
code_block = CodeBlock { "Interior"; }
eq = function == code_block
filterByBoolMask = List.FilterByBoolMask(list=all_elements_of_category, mask=eq)

# group: Group Walls By Level and Get Counts
code_block_2 = CodeBlock { "Base Constraint"; }
getParameterValueByName = Element.GetParameterValueByName(element=filterByBoolMask.in, parameterName=code_block_2)
groupByKey = List.GroupByKey(list=filterByBoolMask.in, keys=getParameterValueByName)
name = Element.Name(element=groupByKey.uniqueKeys)
count = List.Count(list=groupByKey.groups, lacing=Longest)
wall_counts_per_level = Watch(count)

# group: Wall Counts Per Level
# Itemize wall counts by level
list_create = List.Create(item0=name, item1=wall_counts_per_level)
transpose = List.Transpose(lists=list_create)
wall_counts_per_level_2 = Watch(transpose)
